# Grasshopper definition db_fetcher.gh (Grasshopper 1.0.7)
# plug-ins: NGon, Chimera, ScriptParasite

# ---- group: Step 1: CSV file path
# 1. Data source
panel = Panel("C:\Users\Sean\Downloads\database.csv")

# ---- group: Metadata Fields
panel_2 = Panel("""spec_id
name
material
amount
unit""")

# ----
refresh = Button()

# ---- group: Step 2: Set Download Directory
# 2. Fetch geometry from database (google cloud store)
panel_3 = Panel("C:\Users\Sean\Downloads\database")

# ----
r_csv = CSharpScript(csv=panel, col_pat="3d_model", refresh=refresh)  # -> data; inputs csv: String, col_pat: String, refresh: Boolean
# ---------- r_csv: C# usings ----------
using System.IO;
using System.Text.RegularExpressions;
# ---------- r_csv: C# ----------
    datas = SearchCsvColumn(csv, col_pat);
    data = datas;
# ---------- r_csv: C# additional code ----------
  List<string> datas = new List<string>();

  private List<string> SearchCsvColumn(string filePath, string pattern)
  {
    var matchedValues = new List<string>();

    if (!File.Exists(filePath))
    {
      Component.AddRuntimeMessage(GH_RuntimeMessageLevel.Error, "File not found");
      return null;
    }

    try
    {
      using (var reader = new StreamReader(filePath))
      {
        int lineCount = 0;
        int colIndex = -1;
        while (!reader.EndOfStream)
        {
          var line = reader.ReadLine();
          var values = ParseCsvLine(line);
          if (lineCount == 0)
          {
            for (var i = 0; i < values.Length; i++)
            {
              var value = values[i];
              if (value.StartsWith(pattern))
              {
                colIndex = i;
                Component.Message = "column: " + (colIndex + 1).ToString();
              }
            }
          }
          else
          {
            if (colIndex == -1)
            {
              Component.AddRuntimeMessage(GH_RuntimeMessageLevel.Error, "Column not found");
              return null;
            }
            for (int i = 0; i < values.Length; i++)
            {
              if (i == colIndex)
              {
                var value = values[i];
                matchedValues.Add(value);
              }
            }
          }
          lineCount++;
        }
      }
    }
    catch (Exception e)
    {
      Component.AddRuntimeMessage(GH_RuntimeMessageLevel.Error, e.Message);
      throw;
    }
    

    return matchedValues;
  }

  private string[] ParseCsvLine(string line)
  {
    var pattern = ",(?=(?:[^\"]*\"[^\"]*\")*(?![^\"]*\"))";
    var regex = new Regex(pattern);
    return regex.Split(line);
  }
# ---------- end r_csv ----------

# ---- group: Step3: fetch from database
fetch = Button()

# ----
# 3. Fetch metadata from csv
r_csv_2 = CSharpScript(csv=panel, col_pat=panel_2, refresh=refresh)  # -> data; inputs csv: String, col_pat: String, refresh: Boolean; same code as r_csv
concat = Concatenate(FragmentA=graft(panel_2), FragmentC=graft(": "), FragmentB=r_csv_2)

# ----
# Todo:
# - check existing file
# - multi threading
fetch_2 = CSharpScript(urls=r_csv, tempDir=panel_3, fetch=fetch)  # -> localPaths; inputs urls: list of String, tempDir: String, fetch: Boolean
# ---------- fetch_2: C# usings ----------
using System.IO;
using System.Net;
# ---------- fetch_2: C# ----------
    
    if (fetch)
    {
      isRuned = true;
      msg = new List<string>();
      files = new List<string>();
      try
      {
        WebClient client = new WebClient();
        if (!Directory.Exists(tempDir))
        {
          Directory.CreateDirectory(tempDir);
        }

        foreach (var url in urls)
        {
          string filename = url.Split('/')[url.Split('/').Length - 1];
          client.DownloadFile(new Uri(url), tempDir + "/" + filename);
          files.Add(tempDir + "/" + filename);
        }
      }
      catch (Exception e)
      {
        msg.Add(e.Message);
        errorInPreviousRun = true;
      }
    }

    if (files.Count > 0)
    {
      localPaths = files;
    }


    if (errorInPreviousRun)
    {
      Component.AddRuntimeMessage(GH_RuntimeMessageLevel.Error, string.Join("\n", msg));
    }
    else if (isRuned)
    {
      Component.AddRuntimeMessage(GH_RuntimeMessageLevel.Remark, "File downloaded at: " + tempDir);
      Component.Message = "Downloaded";
    }
# ---------- fetch_2: C# additional code ----------
  List<string> msg;
  private bool errorInPreviousRun = false;
  private bool isRuned = false;
  private List<string> files;
# ---------- end fetch_2 ----------
here = Here()  # -> FolderPath, Directory, ScriptPath

scriptpar = ScriptParasite(Enable=Toggle(True), Folder=here.FolderPath)
unzip = CSharpScript(paths=flatten(fetch_2), run=Button())  # -> unziped; inputs paths: list of String, run: Boolean
# ---------- unzip: C# usings ----------
using System.IO;
using System.IO.Compression;
# ---------- unzip: C# ----------
    if (run)
    {
      _files.Clear();
      string unzipPath = Path.GetDirectoryName(paths[0]) + "/unziped";

      // create a new folder
      Directory.CreateDirectory(unzipPath);
      int count = 0;
      foreach (var path in paths)
      {
        // check if the file is a gz file
        if (Path.GetExtension(path) == ".gz")
        {
          var decompressFile = DecompressFile(path, unzipPath);
          _files.Add(decompressFile);
          count++;
        }
        else
        {
          _files.Add(path);
        }
      }

      if (count == 0)
      {
        Component.Message = "No gz file found.\nYou can continue.";
      }
      else
      {
        Component.Message = "Done!\nUnzip " + count + " files";
      }
      
    }
    unziped = _files;
# ---------- unzip: C# additional code ----------
  private List<string> _files = new List<string>();

  private string DecompressFile(string path, string outDirectory)
  {
    var gzipFileName = Path.GetFileName(path); // Get the file name from the path (example.txt.gz)
    var originalFileName = Path.GetFileNameWithoutExtension(gzipFileName); // Remove the .gz extension (example.txt)

    var targetFilePath = Path.Combine(outDirectory, originalFileName); // Combine the output directory with the file name

    using (FileStream originalFileStream = File.OpenRead(path))
    {
      using (FileStream decompressedFileStream = File.Create(targetFilePath))
      {
        using (GZipStream decompressionStream = new GZipStream(originalFileStream, CompressionMode.Decompress))
        {
          decompressionStream.CopyTo(decompressedFileStream);
        }
      }
    }

    return targetFilePath;
  }
# ---------- end unzip ----------

# ---- group: Step 4: enable import
toggle = BooleanToggle(True)

# ---- group: step 5: release data to import
dam = DataDam(DataA=unzip, BufferDelay=10000000, BufferMode=0)

# ---- group: Text Controls
text_line_height = Slider(716, range=0..1000)
text_shift_left = Slider(1500, range=0..1500)
text_size = Slider(488, range=0..1000)
text_bold = BooleanToggle(True)

# ----
import_mesh = CSharpScript(localPaths=dam, import=toggle)  # -> mesh; inputs localPaths: list of String, import: Boolean
# ---------- import_mesh: C# usings ----------
using System.Linq;
# ---------- import_mesh: C# ----------
    if (import)
    {
      meshes.Clear();
      foreach (var path in localPaths)
      {
        var _geometries = ImportMesh(path);

        foreach (var geo in _geometries)
        {
          if (geo is Mesh)
          {
            meshes.Add(geo as Mesh);
          }
        }
      }
    }

    mesh = meshes;
# ---------- import_mesh: C# additional code ----------
  private List<Mesh> meshes = new List<Mesh>();

  private List<GeometryBase> ImportMesh(string path)
  {
    RhinoDoc.ActiveDoc.Objects.UnselectAll();
    string cmd = "-_Import \"" + path + "\" _Enter";
    Rhino.RhinoApp.RunScript(cmd, false);

    cmd = "-_SelAll \"" + "\" _Enter";
    Rhino.RhinoApp.RunScript(cmd, false);

    cmd = "-_Mesh \"" + "\" _Enter";
    Rhino.RhinoApp.RunScript(cmd, false);

    cmd = "-_SelMesh \"" + "\" _Enter";
    Rhino.RhinoApp.RunScript(cmd, false);

    cmd = "-_Join \"" + "\" _Enter";
    Rhino.RhinoApp.RunScript(cmd, false);

    // get the selected objects
    var selectObjs = RhinoDoc.ActiveDoc.Objects.GetSelectedObjects(false, false).ToList();
    List<GeometryBase> geos = new List<GeometryBase>();

    // get the meshes
    foreach (var selectObj in selectObjs)
    {
      GeometryBase geo = selectObj.Geometry;
      geos.Add(geo);
      RhinoDoc.ActiveDoc.Objects.Delete(selectObj, true);
    }
    return geos;
  }
# ---------- end import_mesh ----------

# ---- group: Grid Controls
# 4. Grid Controls
grid_size_u = Slider(2018, range=0..15000)
grid_size_v = Slider(7420, range=0..10000)
grid_u_count = Slider(10, range=0..100)
grid_v_count = Slider(10, range=0..100)

# ---- group: Output Mesh
mesh = Mesh([import_mesh, dam])

# ----
# Rotate Geometry
Y = UnitY(Factor=1)
Z = UnitZ(Factor=1)
pl = ConstructPlane(Origin=Point(0, 0, 0), XAxis=Y, YAxis=Z)
rotate = Rotate(Geometry=mesh, Angle=1.570796327, Plane=pl)  # -> Geometry, Transform

# ----
# Create Grid
lng = ListLength(List=mesh)
flip = FlipMatrix(Data=concat)
lng_2 = ListLength(List=flip)
series = Series(Start=text_line_height, Step=text_line_height, Count=lng_2)
neg = Negative(Value=series)
Y_2 = UnitY(Factor=neg)
neg_2 = Negative(Value=text_shift_left)
X = UnitX(Factor=neg_2)

# ----
# Orient Geometry
bbox = BoundingBox(Content=rotate.Geometry, Plane=PlaneXY(0, 0, 0))  # -> Box, Box_2
brep = Brep(bbox.Box)
ground = GroundPlane(Geometry=brep)  # -> BaseGeo, GroundPlane, GroundCenterPoint
pl_2 = ConstructPlane(Origin=ground.GroundCenterPoint, XAxis=Vector(1, 0, 0), YAxis=Vector(0, 1, 0))

debox = DeconstructBox(Box=bbox.Box)  # -> Plane, X, Y, Z
num = Number(debox.X)
num_2 = Number(debox.Y)
num_3 = Number(debox.Z)
c_script = CSharpScript(num=num)  # -> largest, smallest; inputs num: list of Double
# ---------- c_script: C# ----------
    double maxNumber = num.Max();
    double minNumber = num.Min();
    largest = maxNumber;
    smallest = minNumber;
# ---------- end c_script ----------
c_script_2 = CSharpScript(num=num_2)  # -> largest, smallest; inputs num: list of Double; same code as c_script
addition = Addition(A=c_script.largest, B=grid_size_u)
addition_2 = Addition(A=c_script_2.largest, B=grid_size_v)

create_grid = CSharpScript(maxPts=lng, sizeU=addition, sizeV=addition_2, u=grid_u_count, v=grid_v_count)  # -> pts, grid; inputs maxPts: Int32, sizeU: Double, sizeV: Double, u: Int32, v: Int32
# ---------- create_grid: C# ----------
    List<Point3d> points = new List<Point3d>();
    List<Polyline> polylines = new List<Polyline>();
    int count = 0;

    for (int i = 0; i < u; i++)
    {
      for (int j = 0; j < v; j++)
      {
        if (count >= maxPts)
        {
          break;
        }
        double x = i * sizeU;
        double y = j * sizeV;
        Point3d pt = new Point3d(x, y, 0);
        points.Add(pt);

        Polyline pl = new Polyline(5);
        pl.Add(x - sizeU / 2, y - sizeV / 2, 0);
        pl.Add(x + sizeU / 2, y - sizeV / 2, 0);
        pl.Add(x + sizeU / 2, y + sizeV / 2, 0);
        pl.Add(x - sizeU / 2, y + sizeV / 2, 0);
        pl.Add(pl[0]); // Closing the polyline
        polylines.Add(pl);

        count++;
      }

      // To exit outer loop as well when the max point limit is reached
      if (count >= maxPts)
      {
        break;
      }
    }

    pts = points;
    grid = polylines;
# ---------- end create_grid ----------
move = Move(Geometry=graft(create_grid.pts), Motion=Y_2)  # -> Geometry, Transform
move_2 = Move(Geometry=move.Geometry, Motion=X)  # -> Geometry, Transform

pl_3 = ConstructPlane(Origin=create_grid.pts, XAxis=Vector(1, 0, 0), YAxis=Vector(0, 1, 0))
orient = Orient(Geometry=rotate.Geometry, Source=pl_2, Target=pl_3)  # -> Geometry, Transform

# ----
# Create Metadata Text Curve
number_slider = Slider(1, range=0..1)
flip_2 = FlipMatrix(Data=concat)
text = Text(
    Location=move_2.Geometry,
    Text=flip_2,
    Size=text_size,
    Bold=text_bold,
    HorizontalAlignment=number_slider,
    VerticalAlignment=Slider(0, range=0..10))

# ---- group: Outputs
# 5. Outputs
metadata_text = Curve(text)
mesh_2 = Mesh(orient.Geometry)
grids = Curve(create_grid.grid)
